# Grasshopper definition Reindl_Split.gh (Grasshopper 1.0.7)

file_path_to_hobo_data = Panel("C:\Users\Timur\Box Sync\_LAB\WeatherStationData\WeatherDataFall2015.csv")
if_measured_in_5_min_steps = Panel("12")
load_and_split_data = CSharpScript(path=file_path_to_hobo_data)  # -> out, Month, Day, Hour, Rad, T, RH, DP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; inputs path: String
# ---------- load_and_split_data: C# ----------
    var month = new List<string>();
    var day = new List<string>();
    var hour = new List<string>();
    var rad = new List<string>();


    var t = new List<string>();
    var rh = new List<string>();
    var pres = new List<string>();
    var dp = new List<string>();
    var ws = new List<string>();
    var wd = new List<string>();


    var lines = File.ReadAllLines(path);

    for(int i = 1; i < lines.Length ;i++) //(var s in lines)
    {

      var s = lines[i];
      var ss = s.Split(',');

      var mdh = ss[1].Split('/');
      //Print(s);
      month.Add(mdh[1]);
      day.Add(mdh[2]);
      hour.Add(ss[2].Split(':')[0]);

      rad.Add(ss[12]);

      t.Add(ss[5]);
      rh.Add(ss[6]);
      dp.Add(ss[7]);
      pres.Add(ss[4]);
      ws.Add(ss[8]);
      wd.Add(ss[11]);

    }


    Month = month;
    Day = day;
    Hour = hour;
    Rad = rad;
    T = t;
    RH = rh;
    DP = dp;
    Pres = pres;
    Wsp = ws;
    Wdir = wd;
# ---------- end load_and_split_data ----------
partition = PartitionList(List=load_and_split_data.Month, Size=if_measured_in_5_min_steps)
partition_2 = PartitionList(List=load_and_split_data.Day, Size=if_measured_in_5_min_steps)
partition_3 = PartitionList(List=load_and_split_data.Hour, Size=if_measured_in_5_min_steps)
partition_4 = PartitionList(List=load_and_split_data.Rad, Size=if_measured_in_5_min_steps)
partition_5 = PartitionList(List=load_and_split_data.T, Size=if_measured_in_5_min_steps)
partition_6 = PartitionList(List=load_and_split_data.RH, Size=if_measured_in_5_min_steps)
file_path_to_hobo_data_2 = Panel("D:\Box Sync\_LAB\WeatherStationData\globRadOtherStation.csv")
num = Number(partition_3)
num_2 = Number(partition)
num_3 = Number(partition_2)
num_4 = Number(partition_4)
num_5 = Number(partition_5)
num_6 = Number(partition_6)
panel = Panel("C:\Users\pkastner\Documents\GitHub\HoboPlot\DL1_Stone_Garden_Tjaden_Hall.csv")
avr = Average(Input=num_2)  # -> flatten(ArithmeticMean)
avr_2 = Average(Input=num_3)  # -> flatten(ArithmeticMean)
avr_3 = Average(Input=num)  # -> flatten(ArithmeticMean)
avr_4 = Average(Input=num_4)  # -> flatten(ArithmeticMean)
avr_5 = Average(Input=num_5)  # -> flatten(ArithmeticMean)
avr_6 = Average(Input=num_6)  # -> flatten(ArithmeticMean)
abs = Absolute(Value=avr_6)
partition_7 = PartitionList(List=avr_3, Size="24")
int = Integer(avr_2)
int_2 = Integer(avr)
int_3 = Integer(avr_3)
panel_2 = Panel(partition_3)
wb = CSharpScript(T=avr_5, RH=abs)  # -> out, WB; inputs T: Double, RH: Double
# ---------- wb: C# ----------
    WB = T * Math.Atan(0.151977 * Math.Pow((RH + 8.313659), 0.5)) +
      Math.Atan(T + RH) - Math.Atan(RH - 1.676331) +
      0.00391838 * Math.Pow(RH, 3.0 / 2.0) * Math.Atan(0.023101 * RH) - 4.686035;
# ---------- end wb ----------
tempdb = Panel(avr_5)
addition = Addition(A=int_3, B="1")
coords = ImportCoordinates(File=panel, Separator=",", XIndex=0, YIndex=1, ZIndex=2)
coords_2 = ImportCoordinates(File=panel, Separator=",", XIndex=3, YIndex=1, ZIndex=2)
panel_3 = Panel(avr_4)
pdecon = Deconstruct(Point=coords)  # -> XComponent, YComponent, ZComponent
pdecon_2 = Deconstruct(Point=coords_2)  # -> XComponent, YComponent, ZComponent
tempwb = Panel(wb.WB)
globaltodiffdir = CSharpScript(
    workDir="C:\temp\",
    lat="42.4433",
    lon="76.5000",
    timezone="-5",
    Month=int_2,
    Day=int,
    Hour=addition,
    GlobalRad=avr_4,
    TOG=Toggle(True))  # -> out, DirNorm, DiffHor; inputs lat: String, lon: String, timezone: String, Month: list of Int32, Day: list of Int32, Hour: list of Int32, GlobalRad: list of Double, TOG: Boolean
# ---------- globaltodiffdir: C# ----------
    System.Text.StringBuilder sb = new System.Text.StringBuilder();
    for (int i = 0; i < Month.Count; i++) {

      sb.AppendLine(Month[i] + " " + Day[i] + " " + Hour[i] + " " + GlobalRad[i]);

    }
    System.IO.File.WriteAllText(workDir + "input.txt", sb.ToString());

    if(TOG){
      System.Diagnostics.ProcessStartInfo pstartInfo = new System.Diagnostics.ProcessStartInfo();
      pstartInfo.Arguments = "-i " + workDir + "input.txt" + " -o " + workDir + "output.txt" + " -m " + timezone + " -l " + lon + " -a " + lat;
      pstartInfo.WorkingDirectory = @"C:\DIVA\DaysimBinaries";
      pstartInfo.FileName = "gen_reindl.exe";

      var p = System.Diagnostics.Process.Start(pstartInfo);
      p.WaitForExit();


      var dirN = new List<string>();
      var diffH = new List<string>();
     // var time = new List<string>();

      string[] input = System.IO.File.ReadAllLines(workDir + "output.txt");
      for (int i = 0; i < input.Length; i++)
      {
        var l = new List<double>();
        string[] splitline = input[i].Split(' ');
       // time.Add(splitline[2]);
        dirN.Add(splitline[3]);
        diffH.Add(splitline[4]);
      }
     // t = time;
      DirNorm = dirN;
      DiffHor = diffH;
    }
# ---------- end globaltodiffdir ----------
rh = Panel(abs)
panel_4 = Panel(globaltodiffdir.DirNorm)
globaltodiffdir_2 = CSharpScript(
    workDir="C:\temp\",
    lat="42.4433",
    lon="76.5000",
    timezone="-5",
    Month=pdecon.XComponent,
    Day=pdecon.YComponent,
    Hour=pdecon.ZComponent,
    GlobalRad=pdecon_2.XComponent,
    TOG=Toggle(False))  # -> out, DirNorm, DiffHor; inputs lat: String, lon: String, timezone: String, Month: list of Int32, Day: list of Int32, Hour: list of Int32, GlobalRad: list of Double, TOG: Boolean
# ---------- globaltodiffdir_2: C# usings ----------
using System.IO;
using System.Linq;
using System.Data;
using System.Drawing;
using System.Reflection;
using System.Windows.Forms;
using System.Xml;
using System.Xml.Linq;
using System.Runtime.InteropServices;

using Rhino.DocObjects;
using Rhino.Collections;
using GH_IO;
using GH_IO.Serialization;
# ---------- globaltodiffdir_2: C# ----------
    System.Text.StringBuilder sb = new System.Text.StringBuilder();
    for (int i = 0; i < Month.Count; i++) {

      sb.AppendLine(Month[i] + " " + Day[i] + " " + Hour[i] + " " + GlobalRad[i]);

    }
    System.IO.File.WriteAllText(workDir + "input.txt", sb.ToString());

    if(TOG){
      System.Diagnostics.ProcessStartInfo pstartInfo = new System.Diagnostics.ProcessStartInfo();
      pstartInfo.Arguments = "-i " + workDir + "input.txt" + " -o " + workDir + "output.txt" + " -m " + timezone + " -l " + lon + " -a " + lat;
      pstartInfo.WorkingDirectory = @"C:\DIVA\DaysimBinaries";
      pstartInfo.FileName = "gen_reindl.exe";

      var p = System.Diagnostics.Process.Start(pstartInfo);
      p.WaitForExit();


      var dirN = new List<string>();
      var diffH = new List<string>();
      // var time = new List<string>();

      string[] input = System.IO.File.ReadAllLines(workDir + "output.txt");
      for (int i = 0; i < input.Length; i++)
      {
        var l = new List<double>();
        string[] splitline = input[i].Split(' ');
        // time.Add(splitline[2]);
        dirN.Add(splitline[3]);
        diffH.Add(splitline[4]);
      }
      // t = time;
      DirNorm = dirN;
      DiffHor = diffH;
    }
# ---------- end globaltodiffdir_2 ----------
panel_5 = Panel(globaltodiffdir.DiffHor)
panel_6 = Panel(globaltodiffdir_2.DirNorm)
panel_7 = Panel(globaltodiffdir_2.DiffHor)
