# Grasshopper definition Weather.gh (Grasshopper 1.0.7)
# plug-ins: Climate Studio: Archsim

panel = Panel("C:\Users\pkastner\Documents\GitHub\HoboPlot\Ithaca_2019.epw")
panel_2 = Panel("C:\Users\remym\Documents\GitHub\HoboPlot\USA_NY_Ithaca_Template.epw")
panel_3 = Panel("C:\Users\remym\Documents\GitHub\HoboPlot\Ithaca_2019.epw")
weather = Weather(
    Location=panel,
    Input_0_Hidden=False,
    Input_0_Name="Location",
    Output_0_Hidden=False,
    Output_0_Name="Location",
    Output_10_Hidden=False,
    Output_10_Name="DiffuseHorizontalRadiation",
    Output_11_Hidden=True,
    Output_11_Name="GlobalHorizontalRadiation",
    Output_12_Hidden=True,
    Output_12_Name="SkyCover",
    Output_13_Hidden=True,
    Output_13_Name="Precipitation",
    Output_14_Hidden=True,
    Output_14_Name="Elev",
    Output_15_Hidden=True,
    Output_15_Name="Azimuth",
    Output_16_Hidden=True,
    Output_16_Name="Vector",
    Output_17_Hidden=True,
    Output_17_Name="Illuminance",
    Output_18_Hidden=True,
    Output_18_Name="DateTime",
    Output_19_Hidden=True,
    Output_19_Name="DryBulbAverages",
    Output_1_Hidden=True,
    Output_1_Name="Latitude",
    Output_20_Hidden=True,
    Output_20_Name="DewPointAverages",
    Output_21_Hidden=True,
    Output_21_Name="DryBulbMinima"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)  # -> Location, DryBulbTemp, RelativeHumidity, WindSpeed, WindDirection, DirectNormalRadiation, DiffuseHorizontalRadiation
c_script = CSharpScript(epw=panel, Reference="C:\Users\pkastner\Documents\GitHub\Eddy3d\Build\Build.Ilmerge\EddyLib.dll")  # -> out, A; inputs epw: String
# ---------- c_script: C# usings ----------
using EddyLib;
# ---------- c_script: C# ----------
    var weather = new EddyLib.Weather(epw);
    A = weather.DryBulbTemp;
# ---------- end c_script ----------
panel_4 = Panel(weather.DryBulbTemp)
panel_5 = Panel(c_script.A)
